# Grasshopper definition RhinoExporter.gh (Grasshopper 1.0.7)

panel = Panel("D:\Unity\School\ALIS_WFC\WaveFunctionCollapseUnity\RhinoExporter\")
panel_2 = Panel("D:\Unity\School\ALIS_WFC\WaveFunctionCollapseUnity\RhinoExporter\Auto\")

# ---- group: INPUT
panel_3 = Panel("D:\Unity\School\ALIS_WFC\WaveFunctionCollapseUnity\RhinoExporter\Auto\")
panel_4 = Panel("""Standard
Facade
Column
Beam
Bathroom
Circulation
Empty""")
panel_5 = Panel("4")
panel_6 = Panel("4")
panel_7 = Panel("1")
panel_8 = Panel("3")
panel_9 = Panel("3")
panel_10 = Panel("block")
panel_11 = Panel("Instances")
number_slider = Slider(1, range=0..5)
number_slider_2 = Slider(0, range=0..10)
button = Button()
tilesize = ConstructPoint(XCoordinate=panel_5, YCoordinate=panel_6, ZCoordinate="6")
numberoftiles = ConstructPoint(XCoordinate=panel_8, YCoordinate=panel_9, ZCoordinate=panel_7)

# ----
panel_12 = Panel("""Standard
Facade
Column
Beam
Bathroom
Circulation
Empty""")

# ---- group: INPUT
mergeneighbours = Panel("11-13")
reflect_x = Panel("""1
2
3
4
5
6
7
8
9
10
11
12
13
14
15
16
17
18""")
panel_13 = Panel("""Standard
Facade
Column
Beam
Bathroom
Circulation
Empty""")
xy_dimension = Slider(6, range=0..10)
z_dimension = Slider(7, range=0..10)
x_tiles = Slider(3, range=0..10)
y_tiles = Slider(3, range=0..10)
z_tiles = Slider(2, range=0..10)
panel_14 = Panel("D:\Unity\School\ALIS_WFC\WaveFunctionCollapseUnity\RhinoExporter\Auto\")
panel_15 = Panel("Instances")
panel_16 = Panel("block")
reflect_y = Panel("""1
2
3
4
5
6
7
8
9
10
11
12
13
14
15
16
18""")
number_slider_3 = Slider(1, range=0..5)
panel_17 = Panel("1")
reflect_z = Panel("""1
2
3
4
6
10
11
12
13
14
15""")
number_slider_4 = Slider(0, range=0..10)
button_2 = Button()
tilesize_2 = ConstructPoint(XCoordinate=xy_dimension, YCoordinate=xy_dimension, ZCoordinate=z_dimension)
numberoftiles_2 = ConstructPoint(XCoordinate=x_tiles, YCoordinate=y_tiles, ZCoordinate=z_tiles)

# ----
panel_18 = Panel("""Standard
Facade
Column
Beam
Bathroom
Circulation
Empty""")
number_slider_5 = Slider(0, range=0..10)
pt = ConstructPoint(XCoordinate="12", YCoordinate="12", ZCoordinate="13")
pt_2 = Point([<point referenced from the Rhino model> x4])
number_slider_6 = Slider(0, range=0..10)
number_slider_7 = Slider(4, range=0..100)
path = FilePath("D:\Unity\School\ALIS_WFC\WaveFunctionCollapseUnity\RhinoExporter\Export\ExportSeed1.xml")
rotate = Panel("""1
2
3
4
5
6
10
11
12
13
14
15""")
pt_3 = ConstructPoint(XCoordinate="12", YCoordinate="12", ZCoordinate="13")
pt_4 = Point([<point referenced from the Rhino model> x4])
panel_19 = Panel(path)
importer = CSharpScript(Import=Button(), Filename=path, BlockNames="block", InstanceLayer="Instances")  # -> out, A; inputs Import: Boolean, Filename: String, BlockNames: String, InstanceLayer: String
# ---------- importer: C# usings ----------
  using System.Linq;
  using System.Xml;
  using System.Xml.Serialization;
using System.Text;
using System.IO;
  using Rhino.DocObjects;
# ---------- importer: C# ----------
    if(Import)
    {
      var assembly = new Assembly();
      assembly.DeserializeObject(Filename);

     /* A = assembly.Instances[3].DefinitionIndex;
      Rhino.RhinoApp.WriteLine(assembly.Instances.Count + "instances loaded");
      foreach (var instance in assembly.Instances)
      {
        Rhino.RhinoApp.Write(instance.Pose.Rotation.ToQuaternion().A + " ");
      }*/



      // Instantiate deserialised instances

      Rhino.DocObjects.InstanceDefinition block = RhinoDocument.InstanceDefinitions.Find(BlockNames);
      foreach (var instance in assembly.Instances)
      {
        Quaternion rotation = instance.Pose.Rotation.ToQuaternion();//.MatrixForm();
        Plane plane;
        rotation.GetRotation(out plane);
        plane.Origin = instance.Pose.Position.ToPoint3d();
        var transform = Transform.PlaneToPlane(Plane.WorldXY, plane);
        // Transform translation = Transform.Translation(instance.Pose.Position.ToVector3d());

        //Transform transform = rotation;

        Int32 instantDef = (int) block.InstanceDefinitionModelSerialNumber;
        var newObject = RhinoDocument.Objects.AddInstanceObject(instantDef, transform);


      }
    }
# ---------- importer: C# additional code ----------
  public class Assembly
  {
    public List<Instance> Instances;

    public void DeserializeObject(string filename)
    {
      XmlSerializer serializer = new XmlSerializer(typeof(Assembly));

      FileStream fs = new FileStream(filename, FileMode.OpenOrCreate);
      TextReader reader = new StreamReader(fs);

      Assembly assembly;
      assembly = (Assembly) serializer.Deserialize(reader);

      Instances = assembly.Instances;
    }
  }

  public struct Instance
  {
    public int DefinitionIndex;
    public ImportedPose Pose;
  }

  public struct ImportedPose
  {
    public ImportedVector3 Position;
    public ImportedQuaternion Rotation;
  }

  public struct ImportedVector3
  {
    public double X;
    public double Y;
    public double Z;

    public Point3d ToPoint3d()
    {
      return new Point3d(X, Y, Z);
    }
  }

  public struct ImportedQuaternion
  {
    public double A;
    public double B;
    public double C;
    public double D;

    public Vector3d ToEuler()
    {
      double xd = A / (1 - D);
      double yd = B / (1 - D);
      double zd = C / (1 - D);

      Vector3d outPoint = new Vector3d(xd, yd, zd);
      return outPoint;
    }

    public Quaternion ToQuaternion()
    {
      return new Quaternion(A, B, C, D);
    }
  }
# ---------- end importer ----------
multiplesampleexporternoconnection = CSharpScript(
    Export=button_2,
    Path=panel_14,
    BlockNames=panel_16,
    InstanceLayer=panel_15,
    density=number_slider_3,
    type=number_slider_4,
    TileDimension=tilesize_2,
    NumberOfTiles=numberoftiles_2,
    EmptyTile=panel_17,
    ReflectX=reflect_x,
    ReflectY=reflect_y,
    ReflectZ=reflect_z,
    Rotate=rotate,
    MergeNeighbours=mergeneighbours)  # -> out, ZeroPoints, A; inputs Export: Boolean, Path: String, BlockNames: list of String, InstanceLayer: String, density: Int32, type: Int32, TileDimension: Vector3d, NumberOfTiles: Vector3d, EmptyTile: Int32, ReflectX: list of Int32, ReflectY: list of Int32, ReflectZ: list of Int32, Rotate: list of Int32, MergeNeighbours: String
# ---------- multiplesampleexporternoconnection: C# usings ----------
  using System.Linq;
  using System.Xml;
  using System.Xml.Serialization;
  using Rhino.DocObjects;
# ---------- multiplesampleexporternoconnection: C# ----------
    int counter = 0;
    List<Vector3d> outA = new List<Vector3d>();
    List<string> neighbourGroupsString = MergeNeighbours.Split('-').ToList();
    List<List<int>> neighbourGroups = new List<List<int>>();
    foreach (var neighbourGroup in neighbourGroupsString)
    {
      neighbourGroups.Add(neighbourGroup.Split(':').Select(s => int.Parse(s)).ToList());
    }

    A = neighbourGroups;

    for (int z = 0; z < NumberOfTiles.Z; z++)
    {
      for (int y = 0; y < NumberOfTiles.Y; y++)
      {
        for (int x = 0; x < NumberOfTiles.X; x++)
        {
          counter++;
          //Check reflections and rotations
          bool refX = ReflectX.Contains(counter);
          bool refY = ReflectY.Contains(counter);
          bool refZ = ReflectZ.Contains(counter);
          bool rotate = Rotate.Contains(counter);

          //Get the neighbours to merge
          List<int> mergeNeighbours = new List<int>();
          for (int i = 0; i < neighbourGroups.Count; i++)
          {
            if(neighbourGroups[i].Contains(counter))mergeNeighbours = neighbourGroups[i];
          }


          String filename = Path + "Sample_" + counter + "_x" + x + "y" + y + "z" + z + ".xml";
          var zeroPoint = new Vector3d (x * TileDimension.X, y * TileDimension.Y, z * TileDimension.Z);
          outA.Add(zeroPoint);

          //set neighbours
          var neighbours = new List<Neighbour>()
            {
              new Neighbour(x == 0 ? counter + (int) (NumberOfTiles.X - 1) : counter - 1),
              new Neighbour(x + 1 == NumberOfTiles.X ? counter - ((int) NumberOfTiles.X - 1) : counter + 1),
              new Neighbour(z == 0 ? counter + (int) (NumberOfTiles.X * NumberOfTiles.Y * (NumberOfTiles.Z - 1)) : counter - (int) (NumberOfTiles.X * NumberOfTiles.Y)),
              new Neighbour(z + 1 == NumberOfTiles.Z ? counter - (int) (NumberOfTiles.X * NumberOfTiles.Y * (NumberOfTiles.Z - 1)) : counter + (int) (NumberOfTiles.X * NumberOfTiles.Y)),
              new Neighbour(y == 0 ? counter + (int) (NumberOfTiles.X * (NumberOfTiles.Y - 1)) : counter - (int) NumberOfTiles.X),
              new Neighbour(y + 1 == NumberOfTiles.Y ? counter - (int) (NumberOfTiles.X * (NumberOfTiles.Y - 1)) : counter + (int) NumberOfTiles.X)
              };

          if(Export)
          {
            Assembly.Export(BlockNames, InstanceLayer, filename, Rhino.RhinoDoc.ActiveDoc, counter, density, type, zeroPoint,
              TileDimension, new Vector3d(x, z, y), neighbours, refX, refY, refZ, rotate, mergeNeighbours);
          }

        }
      }
    }
    ZeroPoints = outA;

    //assembly.Export(BlockNames,IntanceLayer,1,1,1,Filename,
# ---------- multiplesampleexporternoconnection: C# additional code ----------
  //Reduced version of the Extensions Unity Exporter script by Vicente
  public class Assembly
  {
    public List<Instance> Instances { get; set; }
    public List<Neighbour> Neighbours { get; set;}
    public int Id;
    public int Density;
    public int Type;
    public Vector3Export Index;
    public bool ReflectX;
    public bool ReflectY;
    public bool ReflectZ;
    public bool Rotate;
    public List<int> MergeNeighbours;
    private Assembly() { }


    public static void Export(List<string> blockNames, string instanceLayerName, string fileName,
      RhinoDoc doc, int id, int density, int type, Vector3d zeroPoint, Vector3d dimensions,
      Vector3d index, List<Neighbour> neighbours, bool refX, bool refY, bool refZ, bool rotate, List<int>mergeNeighbours)
    {
      var definitions = blockNames.Select(n => doc.InstanceDefinitions.First(i => i.Name == n));
      var instanceLayer = doc.Layers.FindName(instanceLayerName);

      var assembly = new Assembly()
        {

          Instances = definitions
          .SelectMany(d => d.GetReferences(1).Where(i => i.Attributes.LayerIndex == instanceLayer.Index))
          .Where(d => CheckInsideTile(zeroPoint, d.InstanceXform, dimensions))
          .Select(d => new Instance(d.InstanceDefinition.Index, d.InstanceXform, zeroPoint))
          .ToList(),

          Id = id,
          Density = density,
          Type = type,
          Index = new Vector3Export((Point3d) index),
          Neighbours = neighbours,
          ReflectX = refX,
          ReflectZ = refY,//reverse for unity y up
          ReflectY = refZ,
          Rotate = rotate,
          MergeNeighbours = mergeNeighbours
          };


      var serializer = new XmlSerializer(typeof(Assembly));
      using (var writer = XmlWriter.Create(fileName))
      {
        serializer.Serialize(writer, assembly);
      }
    }

    static bool CheckInsideTile(Vector3d zeroPoint, Transform pointToCheck, Vector3d dimensions)
    {
      var plane = Plane.WorldXY;
      plane.Transform(pointToCheck);
      float tol = 0.1f;
      bool inside = true;
      if (plane.Origin.X < zeroPoint.X - tol || plane.Origin.X >= zeroPoint.X + dimensions.X - tol)inside = false;
      if (plane.Origin.Y < zeroPoint.Y - tol || plane.Origin.Y >= zeroPoint.Y + dimensions.Y - tol)inside = false;
      if (plane.Origin.Z < zeroPoint.Z - tol || plane.Origin.Z >= zeroPoint.Z + dimensions.Z - tol)inside = false;

      return inside;
    }
  }

  public class Neighbour
  {
    public List<int> Neighbours;

    private Neighbour(){}
    public Neighbour(List<int> neighbours)
    {
      Neighbours = neighbours;
    }

    public Neighbour(int neighbour)
    {
      Neighbours = new List<int>();
      Neighbours.Add(neighbour);
    }
  }

  public class Instance
  {
    public int DefinitionIndex;
    public Pose Pose;


    private Instance() { }

    public Instance(int definitionIndex, Transform transform, Vector3d zeroPoint)
    {
      DefinitionIndex = definitionIndex;

      var plane = Plane.WorldXY;
      plane.Transform(transform);
      Pose = new Pose(plane, zeroPoint);
    }
  }

  [XmlType(TypeName = "Vector3")]
  public struct Vector3Export
  {
    public float x, y, z;

    public Vector3Export(Point3d point)
    {
      x = (float) point.X;
      y = (float) point.Z;
      z = (float) point.Y;
    }

    public Vector3Export(Point3f point)
    {
      x = point.X;
      y = point.Z;
      z = point.Y;
    }
  }

  [XmlType(TypeName = "Vector2")]
  public struct Vector2Export
  {
    public float x, y;

    public Vector2Export(Point2f point)
    {
      x = point.X;
      y = point.Y;
    }
  }

  public struct Pose
  {
    public Vector3Export position;
    public QuaternionExport rotation;

    public Pose(Plane plane, Vector3d zeroPoint)
    {
      position = new Vector3Export(plane.Origin - zeroPoint);
      rotation = new QuaternionExport(plane);
    }
  }

  [XmlType(TypeName = "Quaternion")]
  public struct QuaternionExport
  {
    public float x, y, z, w;

    public QuaternionExport(Plane plane)
    {
      var q = Quaternion.Rotation(Plane.WorldXY, plane);

      w = (float) -q.A;
      x = (float) q.B;
      y = (float) q.D;
      z = (float) q.C;
    }
  }
# ---------- end multiplesampleexporternoconnection ----------
onesampleexporter = CSharpScript(
    Export=Button(),
    Path=panel,
    BlockNames="block",
    InstanceLayer="Instances",
    id=Slider(4, range=0..100),
    density=Slider(1, range=0..5),
    type=number_slider_5,
    minX="3",
    plusX="3",
    minY="3",
    plusY="3",
    minZ="5",
    plusZ="5",
    ZeroPoint=pt_2,
    TileDimension=pt)  # -> out; inputs Export: Boolean, Path: String, BlockNames: list of String, InstanceLayer: String, id: Int32, density: Int32, type: Int32, minX: list of Int32, plusX: list of Int32, minY: list of Int32, plusY: list of Int32, minZ: list of Int32, plusZ: list of Int32, ZeroPoint: Vector3d, TileDimension: Vector3d
# ---------- onesampleexporter: C# ----------
    String filename = Path + "Sample_" + id + ".xml";

    if(Export)
      Assembly.Export(BlockNames, InstanceLayer, filename, Rhino.RhinoDoc.ActiveDoc, minX, plusX, minY, plusY, minZ, plusZ, id, density, type, ZeroPoint, TileDimension);

    //assembly.Export(BlockNames,IntanceLayer,1,1,1,Filename,
# ---------- onesampleexporter: C# additional code ----------
  //Reduced version of the Extensions Unity Exporter script by Vicente
  public class Assembly
  {
    public List<Instance> Instances { get; set; }
    public List<Neighbour> Neighbours { get; set;}
    public int Id;
    public int Density;
    public int Type;
    private Assembly() { }

    public static void Export(List<string> blockNames, string instanceLayerName, string fileName, RhinoDoc doc, List<int>minX, List<int>plusX,
      List<int>minY, List<int>plusY, List<int>minZ, List<int>plusZ, int id, int density, int type, Vector3d zeroPoint, Vector3d dimensions)
    {
      var definitions = blockNames.Select(n => doc.InstanceDefinitions.First(i => i.Name == n));
      var instanceLayer = doc.Layers.FindName(instanceLayerName);

      var assembly = new Assembly()
        {

          Instances = definitions
          .SelectMany(d => d.GetReferences(1).Where(i => i.Attributes.LayerIndex == instanceLayer.Index))
          .Where(d => CheckInsideTile(zeroPoint, d.InstanceXform, dimensions))
          .Select(d => new Instance(d.InstanceDefinition.Index, d.InstanceXform, zeroPoint))
          .ToList()
          };



      assembly.Neighbours = new List<Neighbour>(){
          new Neighbour(minX),
          new Neighbour(plusX),
          new Neighbour(minZ),
          new Neighbour(plusZ),
          new Neighbour(minY),
          new Neighbour(plusY)};
      assembly.Id = id;
      assembly.Density = density;
      assembly.Type = type;

      var serializer = new XmlSerializer(typeof(Assembly));
      using (var writer = XmlWriter.Create(fileName))
      {
        serializer.Serialize(writer, assembly);
      }
    }

    static bool CheckInsideTile(Vector3d zeroPoint, Transform pointToCheck, Vector3d dimensions)
    {
      var plane = Plane.WorldXY;
      plane.Transform(pointToCheck);
      bool inside = false;
      if (plane.Origin.X >= zeroPoint.X && plane.Origin.X <= zeroPoint.X + dimensions.X)inside = true;
      if (inside && plane.Origin.Y >= zeroPoint.Y && plane.Origin.Y <= zeroPoint.Y + dimensions.Y)inside = true;
      if (inside && plane.Origin.Z >= zeroPoint.Z && plane.Origin.Z <= zeroPoint.Z + dimensions.Z)inside = true;

      return inside;
    }
  }

  public class Neighbour
  {
    public List<int> Neighbours;

    private Neighbour(){}
    public Neighbour(List<int> neighbours)
    {
      Neighbours = neighbours;
    }
  }

  public class Instance
  {
    public int DefinitionIndex;
    public Pose Pose;


    private Instance() { }

    public Instance(int definitionIndex, Transform transform, Vector3d zeroPoint)
    {
      DefinitionIndex = definitionIndex;

      var plane = Plane.WorldXY;
      plane.Transform(transform);
      Pose = new Pose(plane, zeroPoint);
    }
  }

  [XmlType(TypeName = "Vector3")]
  public struct Vector3Export
  {
    public float x, y, z;

    public Vector3Export(Point3d point)
    {
      x = (float) point.X;
      y = (float) point.Z;
      z = (float) point.Y;
    }

    public Vector3Export(Point3f point)
    {
      x = point.X;
      y = point.Z;
      z = point.Y;
    }
  }

  [XmlType(TypeName = "Vector2")]
  public struct Vector2Export
  {
    public float x, y;

    public Vector2Export(Point2f point)
    {
      x = point.X;
      y = point.Y;
    }
  }

  public struct Pose
  {
    public Vector3Export position;
    public QuaternionExport rotation;

    public Pose(Plane plane, Vector3d zeroPoint)
    {
      position = new Vector3Export(plane.Origin - zeroPoint);
      rotation = new QuaternionExport(plane);
    }
  }

  [XmlType(TypeName = "Quaternion")]
  public struct QuaternionExport
  {
    public float x, y, z, w;

    public QuaternionExport(Plane plane)
    {
      var q = Quaternion.Rotation(Plane.WorldXY, plane);

      w = (float) -q.A;
      x = (float) q.B;
      y = (float) q.D;
      z = (float) q.C;
    }
  }
# ---------- end onesampleexporter ----------
item = ListItem(List=panel_12, Index=number_slider_5, Wrap=False)
rec = DataRecorder(importer.A, DataLimit=-10, RecordData=True)
panel_20 = Panel(importer.out)
panel_21 = Panel(rec)
multiplesampleexporterbypoint = CSharpScript(
    Export=Button(),
    Path=panel_2,
    BlockNames="block",
    InstanceLayer="Instances",
    density=Slider(1, range=0..5),
    type=number_slider_6,
    ZeroPoints=pt_4,
    TileDimension=pt_3)  # -> out; inputs Export: Boolean, Path: String, BlockNames: list of String, InstanceLayer: String, density: Int32, type: Int32, ZeroPoints: list of Vector3d, TileDimension: Vector3d
# ---------- multiplesampleexporterbypoint: C# ----------
    if(Export)

      for (int i = 1; i < ZeroPoints.Count+1; i++)
      {
        String filename = Path + "Sample_" + i + ".xml";
        Assembly.Export(BlockNames, InstanceLayer, filename, Rhino.RhinoDoc.ActiveDoc, i, density, type, ZeroPoints[i-1], TileDimension);
      }



    //assembly.Export(BlockNames,IntanceLayer,1,1,1,Filename,
# ---------- multiplesampleexporterbypoint: C# additional code ----------
  //Reduced version of the Extensions Unity Exporter script by Vicente
  public class Assembly
  {
    public List<Instance> Instances { get; set; }
    public List<Neighbour> Neighbours { get; set;}
    public int Id;
    public int Density;
    public int Type;
    private Assembly() { }

    public static void Export(List<string> blockNames, string instanceLayerName, string fileName, RhinoDoc doc, int id, int density, int type, Vector3d zeroPoint, Vector3d dimensions)
    {
      var definitions = blockNames.Select(n => doc.InstanceDefinitions.First(i => i.Name == n));
      var instanceLayer = doc.Layers.FindName(instanceLayerName);

      var assembly = new Assembly()
        {

          Instances = definitions
          .SelectMany(d => d.GetReferences(1).Where(i => i.Attributes.LayerIndex == instanceLayer.Index))
          .Where(d => CheckInsideTile(zeroPoint, d.InstanceXform, dimensions))
          .Select(d => new Instance(d.InstanceDefinition.Index, d.InstanceXform, zeroPoint))
          .ToList()
          };



      /*assembly.Neighbours = new List<Neighbour>(){
          new Neighbour(minX),
          new Neighbour(plusX),
          new Neighbour(minZ),
          new Neighbour(plusZ),
          new Neighbour(minY),
          new Neighbour(plusY)};*/
      assembly.Id = id;
      assembly.Density = density;
      assembly.Type = type;

      var serializer = new XmlSerializer(typeof(Assembly));
      using (var writer = XmlWriter.Create(fileName))
      {
        serializer.Serialize(writer, assembly);
      }
    }

    static bool CheckInsideTile(Vector3d zeroPoint, Transform pointToCheck, Vector3d dimensions)
    {
      var plane = Plane.WorldXY;
      plane.Transform(pointToCheck);
      bool inside = false;
      if (plane.Origin.X >= zeroPoint.X && plane.Origin.X <= zeroPoint.X + dimensions.X)inside = true;
      if (inside && plane.Origin.Y >= zeroPoint.Y && plane.Origin.Y <= zeroPoint.Y + dimensions.Y)inside = true;
      if (inside && plane.Origin.Z >= zeroPoint.Z && plane.Origin.Z <= zeroPoint.Z + dimensions.Z)inside = true;

      return inside;
    }
  }

  public class Neighbour
  {
    public List<int> Neighbours;

    private Neighbour(){}
    public Neighbour(List<int> neighbours)
    {
      Neighbours = neighbours;
    }
  }

  public class Instance
  {
    public int DefinitionIndex;
    public Pose Pose;


    private Instance() { }

    public Instance(int definitionIndex, Transform transform, Vector3d zeroPoint)
    {
      DefinitionIndex = definitionIndex;

      var plane = Plane.WorldXY;
      plane.Transform(transform);
      Pose = new Pose(plane, zeroPoint);
    }
  }

  [XmlType(TypeName = "Vector3")]
  public struct Vector3Export
  {
    public float x, y, z;

    public Vector3Export(Point3d point)
    {
      x = (float) point.X;
      y = (float) point.Z;
      z = (float) point.Y;
    }

    public Vector3Export(Point3f point)
    {
      x = point.X;
      y = point.Z;
      z = point.Y;
    }
  }

  [XmlType(TypeName = "Vector2")]
  public struct Vector2Export
  {
    public float x, y;

    public Vector2Export(Point2f point)
    {
      x = point.X;
      y = point.Y;
    }
  }

  public struct Pose
  {
    public Vector3Export position;
    public QuaternionExport rotation;

    public Pose(Plane plane, Vector3d zeroPoint)
    {
      position = new Vector3Export(plane.Origin - zeroPoint);
      rotation = new QuaternionExport(plane);
    }
  }

  [XmlType(TypeName = "Quaternion")]
  public struct QuaternionExport
  {
    public float x, y, z, w;

    public QuaternionExport(Plane plane)
    {
      var q = Quaternion.Rotation(Plane.WorldXY, plane);

      w = (float) -q.A;
      x = (float) q.B;
      y = (float) q.D;
      z = (float) q.C;
    }
  }
# ---------- end multiplesampleexporterbypoint ----------
multiplesampleexporterfullyauto2d = CSharpScript(
    Export=button,
    Path=panel_3,
    BlockNames=panel_10,
    InstanceLayer=panel_11,
    density=number_slider,
    type=number_slider_2,
    TileDimension=tilesize,
    NumberOfTiles=numberoftiles)  # -> out, A; inputs Export: Boolean, Path: String, BlockNames: list of String, InstanceLayer: String, density: Int32, type: Int32, TileDimension: Vector3d, NumberOfTiles: Vector3d
# ---------- multiplesampleexporterfullyauto2d: C# ----------
    int counter = 0;
    List<Vector3d> outA = new List<Vector3d>();

    for (int z = 0; z < NumberOfTiles.Z; z++)
    {
      for (int y = 0; y < NumberOfTiles.Y; y++)
      {
        for (int x = 0; x < NumberOfTiles.X; x++)
        {
          counter++;
          String filename = Path + "Sample_x" + x + "y" + y + "z" + z + ".xml";
          var zeroPoint = new Vector3d (x * TileDimension.X, y * TileDimension.Y, z * TileDimension.Z);
          outA.Add(zeroPoint);

          //set neighbours
          var neighbours = new List<Neighbour>()
            {
              new Neighbour(x == 0 ? int.MinValue : counter - 1),
              new Neighbour(x + 1 == NumberOfTiles.X ? int.MinValue : counter),
              new Neighbour(z == 0 ? int.MinValue : (int) (2 * NumberOfTiles.X * NumberOfTiles.Y * NumberOfTiles.Z + counter - (NumberOfTiles.X * NumberOfTiles.Y))),
              new Neighbour(z + 1 == NumberOfTiles.Z ? int.MinValue : (int) (2 * NumberOfTiles.X * NumberOfTiles.Y * NumberOfTiles.Z + counter)),
              new Neighbour(y == 0 ? int.MinValue : (int) (NumberOfTiles.X * NumberOfTiles.Y * NumberOfTiles.Z + counter - NumberOfTiles.X)),
              new Neighbour(y + 1 == NumberOfTiles.Y ? int.MinValue : (int) ( NumberOfTiles.X * NumberOfTiles.Y * NumberOfTiles.Z + counter))
              };

          if(Export)
          {
            Assembly.Export(BlockNames, InstanceLayer, filename, Rhino.RhinoDoc.ActiveDoc, counter, density, type, zeroPoint, TileDimension, new Vector3d(x, z, y), neighbours);
          }

        }
      }
    }
    A = outA;





    //assembly.Export(BlockNames,IntanceLayer,1,1,1,Filename,
# ---------- multiplesampleexporterfullyauto2d: C# additional code ----------
  //Reduced version of the Extensions Unity Exporter script by Vicente
  public class Assembly
  {
    public List<Instance> Instances { get; set; }
    public List<Neighbour> Neighbours { get; set;}
    public int Id;
    public int Density;
    public int Type;
    public Vector3Export Index;
    private Assembly() { }


    public static void Export(List<string> blockNames, string instanceLayerName, string fileName, RhinoDoc doc, int id, int density, int type, Vector3d zeroPoint, Vector3d dimensions, Vector3d index, List<Neighbour> neighbours)
    {
      var definitions = blockNames.Select(n => doc.InstanceDefinitions.First(i => i.Name == n));
      var instanceLayer = doc.Layers.FindName(instanceLayerName);

      var assembly = new Assembly()
        {

          Instances = definitions
          .SelectMany(d => d.GetReferences(1).Where(i => i.Attributes.LayerIndex == instanceLayer.Index))
          .Where(d => CheckInsideTile(zeroPoint, d.InstanceXform, dimensions))
          .Select(d => new Instance(d.InstanceDefinition.Index, d.InstanceXform, zeroPoint))
          .ToList()
          };



      /*assembly.Neighbours = new List<Neighbour>(){
          new Neighbour(minX),
          new Neighbour(plusX),
          new Neighbour(minZ),
          new Neighbour(plusZ),
          new Neighbour(minY),
          new Neighbour(plusY)};*/
      assembly.Id = id;
      assembly.Density = density;
      assembly.Type = type;
      assembly.Index = new Vector3Export((Point3d) index);
      assembly.Neighbours = neighbours;

      var serializer = new XmlSerializer(typeof(Assembly));
      using (var writer = XmlWriter.Create(fileName))
      {
        serializer.Serialize(writer, assembly);
      }
    }

    static bool CheckInsideTile(Vector3d zeroPoint, Transform pointToCheck, Vector3d dimensions)
    {
      var plane = Plane.WorldXY;
      plane.Transform(pointToCheck);
      float tol = 0.1f;
      bool inside = true;
      if (plane.Origin.X < zeroPoint.X - tol || plane.Origin.X >= zeroPoint.X + dimensions.X - tol)inside = false;
      if (plane.Origin.Y < zeroPoint.Y - tol || plane.Origin.Y >= zeroPoint.Y + dimensions.Y - tol)inside = false;
      if (plane.Origin.Z < zeroPoint.Z - tol || plane.Origin.Z >= zeroPoint.Z + dimensions.Z - tol)inside = false;

      return inside;
    }
  }

  public class Neighbour
  {
    public List<int> Neighbours;

    private Neighbour(){}
    public Neighbour(List<int> neighbours)
    {
      Neighbours = neighbours;
    }

    public Neighbour(int neighbour)
    {
      Neighbours = new List<int>();
      Neighbours.Add(neighbour);
    }
  }

  public class Instance
  {
    public int DefinitionIndex;
    public Pose Pose;


    private Instance() { }

    public Instance(int definitionIndex, Transform transform, Vector3d zeroPoint)
    {
      DefinitionIndex = definitionIndex;

      var plane = Plane.WorldXY;
      plane.Transform(transform);
      Pose = new Pose(plane, zeroPoint);
    }
  }

  [XmlType(TypeName = "Vector3")]
  public struct Vector3Export
  {
    public float x, y, z;

    public Vector3Export(Point3d point)
    {
      x = (float) point.X;
      y = (float) point.Z;
      z = (float) point.Y;
    }

    public Vector3Export(Point3f point)
    {
      x = point.X;
      y = point.Z;
      z = point.Y;
    }
  }

  [XmlType(TypeName = "Vector2")]
  public struct Vector2Export
  {
    public float x, y;

    public Vector2Export(Point2f point)
    {
      x = point.X;
      y = point.Y;
    }
  }

  public struct Pose
  {
    public Vector3Export position;
    public QuaternionExport rotation;

    public Pose(Plane plane, Vector3d zeroPoint)
    {
      position = new Vector3Export(plane.Origin - zeroPoint);
      rotation = new QuaternionExport(plane);
    }
  }

  [XmlType(TypeName = "Quaternion")]
  public struct QuaternionExport
  {
    public float x, y, z, w;

    public QuaternionExport(Plane plane)
    {
      var q = Quaternion.Rotation(Plane.WorldXY, plane);

      w = (float) -q.A;
      x = (float) q.B;
      y = (float) q.D;
      z = (float) q.C;
    }
  }
# ---------- end multiplesampleexporterfullyauto2d ----------
item_2 = ListItem(List=panel_18, Index=number_slider_6, Wrap=False)
list_item = ListItem(List=panel_4, Index=number_slider_2, Wrap=False)
list_item_2 = ListItem(List=panel_13, Index=number_slider_4, Wrap=False)
panel_22 = Panel(onesampleexporter)
panel_23 = Panel(item)
panel_24 = Panel(list_item)
panel_25 = Panel(multiplesampleexporternoconnection.out)
zeropoints = Point(multiplesampleexporternoconnection.ZeroPoints)
panel_26 = Panel(list_item_2)
panel_27 = Panel(multiplesampleexporterbypoint)
panel_28 = Panel(item_2)
zeropoints_2 = Point(multiplesampleexporterfullyauto2d.A)
panel_29 = Panel(multiplesampleexporterfullyauto2d.out)
drawgrid = DrawGrid(A_2=zeropoints_2, A=zeropoints_2, X=panel_5, Y=panel_6)

# ---- group: Tag
multiplication = Multiplication(A=panel_8, B=panel_9, C=panel_7)
X = UnitX(Factor=".5")
Y = UnitY(Factor=".5")
series = Series(Start=1, Step=1, Count=multiplication)
addition = Addition(A=X, B=Y)
move = Move(Geometry=zeropoints_2, Motion=addition)  # -> Geometry, Transform
tag = TextTag(Location=move.Geometry, Text=series, Colour=ColourSwatch(SwatchColor=RGB(255, 255, 255)))

# ----
geo = Geometry(drawgrid)

# ---- group: Tag
multiplication_2 = Multiplication(A=x_tiles, B=y_tiles, C=z_tiles)
X_2 = UnitX(Factor=".5")
Y_2 = UnitY(Factor=".5")
series_2 = Series(Start=1, Step=1, Count=multiplication_2)
addition_2 = Addition(A=X_2, B=Y_2)
move_2 = Move(Geometry=zeropoints, Motion=addition_2)  # -> Geometry, Transform
tag_2 = TextTag(Location=move_2.Geometry, Text=series_2, Colour=ColourSwatch(SwatchColor=RGB(255, 0, 0)))

# ----
drawgrid_2 = DrawGrid(A_2=zeropoints, A=zeropoints, X=xy_dimension, Y=xy_dimension)
geo_2 = Geometry(drawgrid_2)

# ==== cluster DrawGrid
X = ClusterInput()
Y = ClusterInput()
pt = ConstructPoint(XCoordinate=X, YCoordinate=Y, ZCoordinate=0)
A = ClusterInput()
addition = Addition(A=A, B=pt)
xy = XYPlane(Origin=addition)
A_2 = ClusterInput()
rec_2pt = Rectangle2Pt(Plane=xy, PointA=A_2, PointB=addition, Radius=0)  # -> Rectangle, Length
pt_2 = ConstructPoint(XCoordinate="-.5", YCoordinate="-.5", ZCoordinate="-.5")
move = Move(Geometry=rec_2pt.Rectangle, Motion=pt_2)  # -> Geometry, Transform
G = ClusterOutput(move.Geometry)
